% Requirement links of Requirement_Linking_Motor_PID.slx (R2024b)

block :23 implements https://d.docs.live.net/2f5c967ff34fd347/Desktop/N_T_KPIT/Requirement_Linking/Excel_Requirements.xlsx#@Simulink_requirement_item_5: Task5
block :23 implements Requirement_simulink_editor.slreqx#5
block :40 implements https://d.docs.live.net/2f5c967ff34fd347/Desktop/N_T_KPIT/Requirement_Linking/Excel_Requirements.xlsx#@Simulink_requirement_item_3: Task3
block :40 implements https://d.docs.live.net/2f5c967ff34fd347/Desktop/N_T_KPIT/Requirement_Linking/Excel_Requirements.xlsx#@Simulink_requirement_item_4: Task4
block :40 implements Requirement_simulink_editor.slreqx#4
block :52 implements https://d.docs.live.net/2f5c967ff34fd347/Desktop/N_T_KPIT/Requirement_Linking/Excel_Requirements.xlsx#@Simulink_requirement_item_2: Task2
block :52 implements Requirement_simulink_editor.slreqx#2
block :53 implements https://d.docs.live.net/2f5c967ff34fd347/Desktop/N_T_KPIT/Requirement_Linking/Excel_Requirements.xlsx#@Simulink_requirement_item_1: Task1
block :53 implements Requirement_simulink_editor.slreqx#1
block :54 implements https://d.docs.live.net/2f5c967ff34fd347/Desktop/N_T_KPIT/Requirement_Linking/Excel_Requirements.xlsx#@Simulink_requirement_item_6: Task6
block :58 implements Requirement_simulink_editor.slreqx#3