# Requirement set Requirement_simulink_editor (R2024b)

## 1 [R1_input] input_check
which signal uis given to the input

### 1.1 [error_check]

### 1.2 [saturation] saturation limit check
the saturation block is the under the limit?

## 2 [R2_PID] PID_Check
PID is meeting the requirement?

## 3 [R3_Plant_Out] motor_speed
is motor is reaching the repuired speed